# Grasshopper definition TernaryPhaseCllippingPlane.gh (Grasshopper 1.0.7)

pt = ConstructPoint(XCoordinate=0, YCoordinate=Slider(25.188, range=-40..40), ZCoordinate=0)
pt_2 = ConstructPoint(XCoordinate=0, YCoordinate=0, ZCoordinate=Slider(10.54, range=0..40))
id = Guid(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)
id_2 = Guid(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)
xz = XZPlane(Origin=pt)
xy = XYPlane(Origin=pt_2)
rotate = Rotate(Geometry=xz, Angle=degrees(Slider(79.56, range=-180..180)), Plane=pt)  # -> Geometry, Transform
c_script = CSharpScript(id=id, pl=rotate.Geometry)  # -> out; inputs id: Guid, pl: Plane
# ---------- c_script: C# ----------
    var cp = new Rhino.DocObjects.ObjRef(id);
    var source = cp.ClippingPlaneSurface().Plane;
    RhinoDoc.ActiveDoc.Objects.Transform(id, Transform.PlaneToPlane(source, pl), true);
# ---------- end c_script ----------
c_script_2 = CSharpScript(id=id_2, pl=xy)  # -> out; inputs id: Guid, pl: Plane; same code as c_script
